# Grasshopper definition example.ghx (Grasshopper 1.0.7)
# plug-ins: Speckle 2, LunchBox

# ---- group: RH_IN:Link
# https://macad.speckle.xyz/streams/6c652abd66
txt = Text()

# ----
sr = SynchronousReceiver(
    Stream=txt,
    AutoReceive=False,
    KitName="Objects",
    ReceivedObjectId="4cc49e84683172f0aa4e374b0f226c2c",
    StreamWrapper="https://macad.speckle.xyz/streams/6c652abd66",
    selectedKitName="Objects")  # -> Data, Info
sovk = SpeckleObjectValueByKey(Object=sr.Data, Key="elements", selectedKitName="Objects")
sovk_2 = SpeckleObjectValueByKey(Object=sovk, Key="elements", selectedKitName="Objects")
sovk_3 = SpeckleObjectValueByKey(Object=sovk_2, Key="parameters", selectedKitName="Objects")
sovk_4 = SpeckleObjectValueByKey(Object=sovk_2, Key="displayValue", selectedKitName="Objects")

sovk_5 = SpeckleObjectValueByKey(Object=sovk_3, Key="faae278b-7fcd-4840-9d5c-fcd1cb2c4068", selectedKitName="Objects")
sovk_6 = SpeckleObjectValueByKey(Object=sovk_5, Key="name", selectedKitName="Objects")
sovk_7 = SpeckleObjectValueByKey(Object=sovk_5, Key="value", selectedKitName="Objects")
panel = Panel(sovk_7)
panel_2 = Panel(sovk_6)

sovk_8 = SpeckleObjectValueByKey(Object=sovk_3, Key="87c493a7-09c4-42fb-8bfb-c683efe1bbf7", selectedKitName="Objects")
sovk_9 = SpeckleObjectValueByKey(Object=sovk_8, Key="name", selectedKitName="Objects")
sovk_10 = SpeckleObjectValueByKey(Object=sovk_8, Key="value", selectedKitName="Objects")
panel_3 = Panel(sovk_10)
panel_4 = Panel(sovk_9)

bbox = BoundingBox(Content=sovk_4, Plane=PlaneXY(0, 0, 0))  # -> Box, Box_2
debrep = DeconstructBrep(Brep=bbox.Box_2)  # -> Faces, Edges, Vertices
item = ListItem(List=debrep.Faces, Index=0, Wrap=True)
trib = TrianglePanelsB(Surface=item, UDivisions=panel_3, VDivisions=panel)
area = Area(Geometry=trib)  # -> Area, Centroid
scale = Scale(Geometry=trib, Center=area.Centroid, Factor=Slider(0.9, range=0..1))  # -> Geometry, Transform
lng = ListLength(List=scale.Geometry)

# ----
# https://macad.speckle.xyz/streams/27b32e7bd2
panel_5 = Panel("0a7a2c01a136ad89e2cfa5e002c9f1bcbe5656a1d0")
sgetwt = StreamGetWithToken(Stream="https://macad.speckle.xyz/streams/2bbf568420", AuthToken=panel_5)

panel_6 = Panel("Receive_From_Compute Stream")
random = Random(Range="0 to 100", Number=lng, Seed=2)
panel_7 = Panel("Bot Speckle Token")
cso = CreateSpeckleObject(Panels=scale.Geometry, Fake_Cost=random, selectedKitName="Objects")

# ---- group: RH_OUT:Cost
num = Number(random)

# ----
ss = SynchronousSender(
    Data=cso,
    Stream=sgetwt,
    OutputWrappers="https://macad.speckle.xyz\t27b32e7bd2\tab5404b2dc",
    UseDefaultCache=True,
    selectedKitName="Objects")
